# Dynamo graph IFC_Coord-Calc and changing IFC.dyn (Dynamo 2.8.0.2015)

file_path = Filename(".\Renga-Demo.ifc")
string = StringInput("C:\Users\GeorgKeneberg\Documents\Temp\temp1.ifc")
string_2 = StringInput("33.297,-7.343,-0.400")
string_3 = StringInput("-8.192,2.370,-0.400")
string_4 = StringInput("33.297,-7.343,-0.400")
string_5 = StringInput("2216240.350,530158.768,142")
string_6 = StringInput("2216208.042,530186.545,142")
string_7 = StringInput("2216221.119,530185.692,142")
createDataMassive = IFC_Coord.General.CreateDataMassive(CurrentCS_Point1=string_2, CurrentCS_Point2=string_3, CurrentCS_Point3=string_4, FinishCS_Point1=string_5, FinishCS_Point2=string_6, FinishCS_Point3=string_7)
findParameters = IFC_Coord.Calculates.FindParameters(Data=createDataMassive)
renga_44 = IFC_Coord.IFC_4.Renga_44(PathToInputIFC=file_path, PathToSaveIFC=string, ΔX=findParameters.Смещение_по_оси_X_м, ΔY=findParameters.Смещение_по_оси_Y_м, ΔZ=findParameters.Смещение_по_оси_Z_м, ωz=findParameters.Угол_поворота_радианы)
