# Dynamo graph IFC_Coord-Calc and save parameters.dyn (Dynamo 2.8.0.2015)

string = StringInput("33.297,-7.343,-0.400")
string_2 = StringInput("-8.192,2.370,-0.400")
string_3 = StringInput("33.297,-7.343,-0.400")
string_4 = StringInput("2216240.350,530158.768,142")
string_5 = StringInput("2216208.042,530186.545,142")
string_6 = StringInput("2216221.119,530185.692,142")
createDataMassive = IFC_Coord.General.CreateDataMassive(CurrentCS_Point1=string, CurrentCS_Point2=string_2, CurrentCS_Point3=string_3, FinishCS_Point1=string_4, FinishCS_Point2=string_5, FinishCS_Point3=string_6)
findParameters = IFC_Coord.Calculates.FindParameters(Data=createDataMassive)
string_7 = StringInput("C:\Users\GeorgKeneberg\Documents\Temp\temp1.xml")
saveResultsOfCalculating = IFC_Coord.Calculates.SaveResultsOfCalculating(ΔX=findParameters.Смещение_по_оси_X_м, ΔY=findParameters.Смещение_по_оси_Y_м, ΔZ=findParameters.Смещение_по_оси_Z_м, ωz=findParameters.Угол_поворота_радианы, error=findParameters.Линейная_ошибка_м, SaveFilePath=string_7)
